# Grasshopper definition exo.gh (Grasshopper 1.0.7)

# ----
# Input body
# Measurements
waist_circumference = Slider(1157, range=500..2000)
leg_length = Slider(942, range=500..1200)

waist_individualized_components = Mesh(<mesh referenced from the Rhino model>)
waist_individualized_components_2 = Mesh(<mesh referenced from the Rhino model>)

# ----
# Input work
# preferences
waist_fixing_components = Mesh(<mesh referenced from the Rhino model>)

division = Division(A=leg_length, B=4)
pt = ConstructPoint(XCoordinate=0, YCoordinate=0, ZCoordinate=0)
multiplication = Multiplication(A=division, B=-1)
X = UnitX(Factor="80")
Y = UnitY(Factor=multiplication)
move = Move(Geometry=pt, Motion=X)  # -> Geometry, Transform
multiplication_2 = Multiplication(A=X, B=-1)
move_2 = Move(Geometry=move.Geometry, Motion=Y)  # -> Geometry, Transform
move_3 = Move(Geometry=move_2.Geometry, Motion=multiplication_2)  # -> Geometry, Transform
move_4 = Move(Geometry=move_3.Geometry, Motion="{15,0,0}")  # -> Geometry, Transform
move_5 = Move(Geometry=move_2.Geometry, Motion="{-15,0,0}")  # -> Geometry, Transform
pline = PolyLine(Vertices=[move.Geometry, move_5.Geometry, move_4.Geometry, pt], Closed=True)
cir = Circle(Plane=pt, Radius="54")
move_6 = Move(Geometry=pline, Motion=expr("{-40,0,0}", Vector(0, 0, 10)))  # -> Geometry, Transform
cir_2 = Circle(Plane=pt, Radius="30")
crv = Curve(cir)
runion = RegionUnion(Curves=[crv, move_6.Geometry])
boundary = BoundarySurfaces(Edges=cir_2)
boundary_2 = BoundarySurfaces(Edges=runion)
Z = UnitZ(Factor="10")
extr = Extrude(Base=boundary, Direction=Z)
extr_2 = Extrude(Base=boundary_2, Direction=Z)
leg_editable_components = SolidDifference(BrepsA=extr_2, BrepsB=extr)

# ----
# Foot
# components
foot_joint_middle = Mesh(<mesh referenced from the Rhino model>)
foot_joint_extra = Mesh([<mesh referenced from the Rhino model> x4])
foot_joint = Mesh([<mesh referenced from the Rhino model> x11])

# ----
# Leg components
yz = YZPlane(Origin=Point(0, 0, 0))
rotate = Rotate(Geometry=leg_editable_components, Angle="-0.5*pi", Plane=yz)  # -> Geometry, Transform
move_7 = Move(Geometry=rotate.Geometry, Motion=expr("{-215.106,-75.8686,79.1452}", Vector(0, 0, 10)))  # -> Geometry, Transform
debrep = DeconstructBrep(Brep=move_7.Geometry)  # -> Faces, Edges, Vertices
item = ListItem(List=debrep.Faces, Index=expr("4", 0), Wrap=True)
leg_connector_lower = Mesh(<mesh referenced from the Rhino model>)
mirror = Mirror(Geometry=move_7.Geometry, Plane=item)  # -> Geometry, Transform
division_2 = Division(A=leg_length, B=2)
movetoplane = MoveToPlane(Geometry=leg_connector_lower, Plane=item, Above=True, Below=True)  # -> Geometry, Transform
brep = Brep([mirror.Geometry, move_7.Geometry])
Z_2 = UnitZ(Factor=division_2)
move_8 = Move(Geometry=movetoplane.Geometry, Motion=expr("{0,0,-43.4}", Vector(0, 0, 10)))  # -> Geometry, Transform
debrep_2 = DeconstructBrep(Brep=brep)  # -> Faces, Edges, flatten(Vertices)
move_9 = Move(Geometry=[brep, move_8.Geometry], Motion=Z_2)  # -> Geometry, Transform
pt_2 = Point(debrep_2.Vertices)
move_10 = Move(Geometry=move_9.Geometry, Motion="{0,-10,0}")  # -> Geometry, Transform
item_2 = ListItem(List=pt_2, Index=expr("1", 0), Wrap=True)
xy = XYPlane(Origin=item_2)
leg_joint = Mesh(<mesh referenced from the Rhino model>)
movetoplane_2 = MoveToPlane(Geometry=leg_joint, Plane=xy, Above=True, Below=True)  # -> Geometry, Transform
move_11 = Move(Geometry=movetoplane_2.Geometry, Motion="{0,0,-112}")  # -> Geometry, Transform

division_3 = Division(A=leg_length, B=2)
subtraction = Subtraction(A=division_3, B=50)
Z_3 = UnitZ(Factor=subtraction)
move_12 = Move(Geometry=xy, Motion=Z_3)  # -> Geometry, Transform

pt_3 = ConstructPoint(XCoordinate=0, YCoordinate=0, ZCoordinate=0)
division_4 = Division(A=waist_circumference, B=8)
rectangle = Rectangle(Plane=pt_3, XSize="100", YSize=division_4, Radius=0)  # -> Rectangle, Length
boundary_3 = BoundarySurfaces(Edges=rectangle.Rectangle)
extr_3 = Extrude(Base=boundary_3, Direction="{0,0,10}")
xz = XZPlane(Origin=Point(0, 0, 0))
rotate_2 = Rotate(Geometry=extr_3, Angle="0.5*pi", Plane=xz)  # -> Geometry, Transform
area = Area(Geometry=rotate_2.Geometry)  # -> Area, Centroid
xz_2 = XZPlane(Origin=area.Centroid)
brep_2 = Brep([<brep referenced from the Rhino model> x2])
mirror_2 = Mirror(Geometry=brep_2, Plane=xz_2)  # -> Geometry, Transform
area_2 = Area(Geometry=waist_fixing_components)  # -> Area, Centroid
sunion = SolidUnion(Breps=[mirror_2.Geometry, brep_2, rotate_2.Geometry])
movetoplane_3 = MoveToPlane(Geometry=sunion, Plane=move_12.Geometry, Above=True, Below=True)  # -> Geometry, Transform
yz_2 = YZPlane(Origin=area_2.Centroid)
move_13 = Move(Geometry=movetoplane_3.Geometry, Motion=expr("{-68.35,96.8,0}", Vector(0, 0, 10)))  # -> Geometry, Transform
mirror_3 = Mirror(Geometry=move_13.Geometry, Plane=yz_2)  # -> Geometry, Transform

# ----
# Waist components
movetoplane_4 = MoveToPlane(
    Geometry=[waist_individualized_components, waist_individualized_components_2, waist_fixing_components],
    Plane=move_12.Geometry,
    Above=True,
    Below=True)  # -> Geometry, Transform

# ----
# Output the
# product model
area_3 = Area(Geometry=move_13.Geometry)  # -> Area, Centroid
xz_3 = XZPlane(Origin=area_3.Centroid)
grp = Group([move_8.Geometry, move_10.Geometry, brep, move_11.Geometry, foot_joint, foot_joint_middle, foot_joint_extra, movetoplane_4.Geometry])
mirror_4 = Mirror(Geometry=grp, Plane=xz_3)  # -> Geometry, Transform
grp_2 = Group([mirror_4.Geometry, grp, move_13.Geometry, mirror_3.Geometry])

# ----
# Output the parts
#  to be printed
arrrec = RectangularArray(
    Geometry=leg_editable_components,
    Cell={Plane=PlaneXY(286.6381687, 148.3001593, 0), Size=Domain2(u=-112.0513609..112.0513609, v=-177.9716308..177.9716308)},
    XCount=expr("2", 6),
    YCount=expr("4", 3))  # -> Geometry, Transform
arrrec_2 = RectangularArray(
    Geometry=sunion,
    Cell={Plane=PlaneXY(176.4337084, 220.9595023, 0), Size=Domain2(u=-95.76975511..95.76975511, v=-156.4069315..156.4069315)},
    XCount=expr("1", 6),
    YCount=expr("2", 3))  # -> Geometry, Transform
mesh = Mesh([<mesh referenced from the Rhino model> x38])
move_14 = Move(Geometry=arrrec.Geometry, Motion=expr("{400,400,0}", Vector(0, 0, 10)))  # -> Geometry, Transform
move_15 = Move(Geometry=arrrec_2.Geometry, Motion=expr("{850,400,0}", Vector(0, 0, 10)))  # -> Geometry, Transform
movetoplane_5 = MoveToPlane(Geometry=mesh, Plane=PlaneXY(0, 0, 0), Above=True, Below=True)  # -> Geometry, Transform
grp_3 = Group([movetoplane_5.Geometry, move_15.Geometry, move_14.Geometry])

material = CreateMaterial(
    Diffuse=ColourSwatch(SwatchColor=RGB(255, 255, 255)),
    Specular=RGB(255, 255, 255),
    Emission=RGB(0, 0, 0),
    Transparency=0,
    Shine=0)
preview = CustomPreview(Geometry=grp_2, Material=material)
material_2 = CreateMaterial(
    Diffuse=ColourSwatch(SwatchColor=RGB(255, 255, 255)),
    Specular=RGB(255, 255, 255),
    Emission=RGB(0, 0, 0),
    Transparency=0,
    Shine=0)
preview_2 = CustomPreview(Geometry=grp_3, Material=material_2)
